# Grasshopper definition Worley_Noise_01.gh (Grasshopper 1.0.7)
# plug-ins: Weaverbird, DendroGH

number_slider = Slider(2, range=0..10)
number_slider_2 = Slider(10, range=0..100)
number_slider_3 = Slider(10, range=0..100)
number_slider_4 = Slider(10, range=0..100)
construct_point = ConstructPoint(XCoordinate=0, YCoordinate=0, ZCoordinate=0)
rectangle = Rectangle(Plane=PlaneXY(0, 0, 0), XSize=number_slider, YSize=number_slider, Radius=0)  # -> Rectangle, Length
series = Series(Start=0, Step=number_slider, Count=number_slider_4)
multiplication = Multiplication(A=number_slider, B=number_slider_2)
multiplication_2 = Multiplication(A=number_slider, B=number_slider_3)
multiplication_3 = Multiplication(A=number_slider, B=number_slider_4)
rectangular_array = RectangularArray(Geometry=construct_point, Cell=rectangle.Rectangle, XCount=number_slider_2, YCount=number_slider_3)  # -> Geometry, Transform
unit_z = UnitZ(Factor=series)  # -> graft(UnitVector)
c_script = CSharpScript(x=multiplication, y=multiplication_2, z=multiplication_3, num=Slider(6, range=0..50))  # -> out, A; inputs x: Int32, y: Int32, z: Int32, num: Int32
# ---------- c_script: C# ----------
    List<Point3d> pts = new List<Point3d>();
    Random rand = new Random();

    for(int i = 0; i < num; i++){
      double x1 = rand.Next(x );
      double y1 = rand.Next(y );
      double z1 = rand.Next(z );
      pts.Add(new Point3d(x1, y1, z1));
    }

    A = pts;
# ---------- end c_script ----------
sphere = Sphere(Base=c_script.A, Radius=1)
move = Move(Geometry=rectangular_array.Geometry, Motion=unit_z)  # -> simplify(Geometry), Transform
panel = Panel(c_script.A)
c_script_2 = CSharpScript(x=move.Geometry, y=c_script.A)  # -> out, A; inputs x: tree of Point3d, y: list of Point3d
# ---------- c_script_2: C# usings ----------
using System.Drawing;
# ---------- c_script_2: C# ----------
    DataTree<GH_Colour> cols = new DataTree<GH_Colour>();
    DataTree<double> di = new DataTree<double>();

    for(int i = 0; i < x.BranchCount; i++){
      GH_Path pa = new GH_Path(i);

      for(int j = 0; j < x.Branch(i).Count; j++){

        List<double> dists = new List<double>();
        for(int k = 0; k < y.Count; k++){
          double dist = x.Branch(i)[j].DistanceTo(y[k]);
          dists.Add(dist);
        }
        dists.Sort();

        //Color cl = Color.FromArgb(i, j, 0);
        //Color cl = Color.FromArgb((int)dists[0]);
        //GH_Colour col = new GH_Colour(cl);

        //cols.Add(col, pa);
        di.Add(dists[0], pa);

      }
    }

    A = di;
# ---------- end c_script_2 ----------
param_viewer = ParamViewer(move.Geometry)
flatten_tree = FlattenTree(Tree=c_script_2.A, Path="{0}")
param_viewer_2 = ParamViewer(c_script_2.A)
sort_list = SortList(Keys=flatten_tree)  # -> Keys, ValuesValuesA
list_item = ListItem(List=sort_list.Keys, Index=0, Wrap=True)  # -> Item1, Item
number_slider_5 = Slider(7.9, range=0..20)
panel_2 = Panel(list_item.Item1)
construct_domain = ConstructDomain(DomainStart=0, DomainEnd=list_item.Item1)
construct_domain_2 = ConstructDomain(DomainStart=0, DomainEnd="255")
center_box = CenterBox(Base=move.Geometry, X=1, Y=1, Z=1)
deconstruct_brep = DeconstructBrep(Brep=center_box)  # -> Faces, Edges, Vertices; disabled
scale = Scale(Geometry=center_box, Center=move.Geometry, Factor=Slider(0.889, range=0..1))  # -> Geometry, Transform
remap_numbers = RemapNumbers(Value=c_script_2.A, Source=construct_domain, Target=construct_domain_2)  # -> Mapped, Clipped
flatten_tree_2 = FlattenTree(Tree=deconstruct_brep.Faces, Path="{0}")
panel_3 = Panel("2")
area = Area(Geometry=flatten_tree_2)  # -> Area, Centroid
gradient = Gradient(
    LowerLimit="0",
    UpperLimit="255",
    Parameter=remap_numbers.Mapped,
    stops=[0.15: RGB(222, 255, 130), 0.85: RGB(0, 161, 219)])
panel_4 = Panel(remap_numbers.Mapped)
cull_duplicates = CullDuplicates(Points=area.Centroid, Tolerance=0.1, CullMode=1)  # -> Points, Indices, Valence
c_script_3 = CSharpScript(num=remap_numbers.Mapped, threshold=Slider(113.276, range=0..255), factor=Slider(5, range=0.1..5))  # -> out, A; inputs num: tree of Double, threshold: Double, factor: Double
# ---------- c_script_3: C# ----------
    for(int i = 0; i < num.BranchCount; i++){
      for(int j = 0; j < num.Branch(i).Count; j++){
        if (num.Branch(i)[j] < threshold) num.Branch(i)[j] = num.Branch(i)[j] / factor;
      }
    }
    A = num;
# ---------- end c_script_3 ----------
split_argb = SplitARGB(Colour=gradient, IntegerChannels=True)  # -> Alpha, Red, Green, Blue
cull_index = CullIndex(List=flatten_tree_2, Indices=cull_duplicates.Indices, Wrap=True)
panel_5 = Panel(c_script_3.A)
deconstruct_brep_2 = DeconstructBrep(Brep=cull_index)  # -> Faces, Edges, Vertices
colour_rgb = ColourRGB(Alpha=c_script_3.A, Red=split_argb.Red, Green=split_argb.Green, Blue=split_argb.Blue)
number_slider_6 = Slider(150, range=0..1000)
join_curves = JoinCurves(Curves=deconstruct_brep_2.Edges, Preserve=False)  # -> simplify(Curves)
param_viewer_3 = ParamViewer(colour_rgb)
custom_preview = CustomPreview(Geometry=center_box, Material=colour_rgb)
polygon_center = PolygonCenter(Polyline=join_curves)  # -> CenterV, CenterE, CenterA
panel_6 = Panel(join_curves)
smaller_than = SmallerThan(FirstNumber=c_script_3.A, SecondNumber=number_slider_6)  # -> SmallerThan, OrEqualTo
larger_than = LargerThan(FirstNumber=c_script_3.A, SecondNumber=number_slider_6)  # -> LargerThan, OrEqualTo
larger_than_2 = LargerThan(FirstNumber=c_script_3.A, SecondNumber=number_slider_6)  # -> LargerThan, OrEqualTo
c_script_4 = CSharpScript(x=polygon_center.CenterV, y=c_script.A)  # -> out, A; inputs x: tree of Point3d, y: list of Point3d; same code as c_script_2
cull_pattern = CullPattern(List=colour_rgb, CullPattern=smaller_than.SmallerThan)
cull_pattern_2 = CullPattern(List=center_box, CullPattern=smaller_than.SmallerThan)
flatten_tree_3 = FlattenTree(Tree=c_script_4.A, Path="{0}")
cull_pattern_3 = CullPattern(List=center_box, CullPattern=larger_than.LargerThan)
cull_pattern_4 = CullPattern(List=colour_rgb, CullPattern=larger_than_2.LargerThan)
sort_list_2 = SortList(Keys=flatten_tree_3)  # -> Keys, ValuesValuesA
flatten_tree_4 = FlattenTree(Tree=cull_pattern_3, Path="{0}")
flatten_tree_5 = FlattenTree(Tree=cull_pattern_4, Path="{0}")
custom_preview_2 = CustomPreview(Geometry=cull_pattern_2, Material=cull_pattern)
list_item_2 = ListItem(List=sort_list_2.Keys, Index=0, Wrap=True)  # -> Item1, Item
mesh = Mesh(flatten_tree_4)
deconstruct_mesh = DeconstructMesh(Mesh=mesh)  # -> Vertices, Faces, Colours, Normals

c_script_5 = CSharpScript(x=deconstruct_mesh.Vertices, y=c_script.A)  # -> out, A; inputs x: tree of Point3d, y: list of Point3d; same code as c_script_2
flatten_tree_6 = FlattenTree(Tree=c_script_5.A, Path="{0}")
sort_list_3 = SortList(Keys=flatten_tree_6)  # -> Keys, ValuesValuesA
list_item_3 = ListItem(List=sort_list_3.Keys, Index=0, Wrap=True)  # -> Item1, Item
panel_7 = Panel(list_item_3.Item1)
construct_domain_3 = ConstructDomain(DomainStart=0, DomainEnd=list_item_3.Item1)
construct_domain_4 = ConstructDomain(DomainStart=0, DomainEnd="255")
remap_numbers_2 = RemapNumbers(Value=c_script_5.A, Source=construct_domain_3, Target=construct_domain_4)  # -> Mapped, Clipped
gradient_2 = Gradient(
    LowerLimit="0",
    UpperLimit="255",
    Parameter=remap_numbers_2.Mapped,
    stops=[0.15: RGB(222, 255, 130), 0.85: RGB(0, 161, 219)])
split_argb_2 = SplitARGB(Colour=gradient_2, IntegerChannels=True)  # -> Alpha, Red, Green, Blue
colour_rgb_2 = ColourRGB(Alpha=c_script_3.A, Red=split_argb_2.Red, Green=split_argb_2.Green, Blue=split_argb_2.Blue)
construct_mesh = ConstructMesh(Vertices=deconstruct_mesh.Vertices, Faces=deconstruct_mesh.Faces, Colours=colour_rgb_2)  # -> flatten(Mesh)

mesh_join = MeshJoin(Meshes=mesh)
construct_domain_5 = ConstructDomain(DomainStart=0, DomainEnd=list_item_2.Item1)
construct_domain_6 = ConstructDomain(DomainStart=Slider(0.001, range=0..1), DomainEnd=Slider(0.99, range=0..1))
remap_numbers_3 = RemapNumbers(Value=c_script_4.A, Source=construct_domain_5, Target=construct_domain_6)  # -> Mapped, Clipped
param_viewer_4 = ParamViewer(remap_numbers_3.Mapped)
weaverbird_s_picture_frame = WeaverbirdsPictureFrame(MeshPolylines=join_curves, Distance=remap_numbers_3.Mapped, InsetType=1)  # -> simplify(flatten(OutMesh))
weaverbird_s_mesh_thicken = WeaverbirdsMeshThicken(MeshCurves=weaverbird_s_picture_frame, Distance=Slider(0.25, range=0..1), OffsetType=1)  # -> flatten(OutputMeshCurves)
mesh_join_2 = MeshJoin(Meshes=weaverbird_s_mesh_thicken)
deconstruct_mesh_2 = DeconstructMesh(Mesh=mesh_join_2)  # -> Vertices, Faces, Colours, Normals
param_viewer_5 = ParamViewer(mesh_join_2)
graft_tree = GraftTree(Tree=deconstruct_mesh_2.Vertices, IncludeEmptyLists=True, IncludeNullItems=True)
c_script_6 = CSharpScript(x=graft_tree, y=c_script.A)  # -> out, A; inputs x: tree of Point3d, y: list of Point3d; same code as c_script_2
flatten_tree_7 = FlattenTree(Tree=c_script_6.A, Path="{0}")
sort_list_4 = SortList(Keys=flatten_tree_7)  # -> Keys, ValuesValuesA
list_item_4 = ListItem(List=sort_list_4.Keys, Index=0, Wrap=True)  # -> Item1, Item
mesh_join_3 = MeshJoin(Meshes=construct_mesh)
gradient_3 = Gradient(
    LowerLimit="0",
    UpperLimit=list_item_4.Item1,
    Parameter=flatten_tree_7,
    stops=[0.15: RGB(222, 255, 130), 0.85: RGB(0, 161, 219)])
panel_8 = Panel(mesh_join_3)
param_viewer_6 = ParamViewer(gradient_3)
split_argb_3 = SplitARGB(Colour=gradient_3, IntegerChannels=True)  # -> Alpha, Red, Green, Blue
colour_rgb_3 = ColourRGB(Alpha=255, Red=split_argb_3.Red, Green=split_argb_3.Green, Blue=split_argb_3.Blue)
construct_mesh_2 = ConstructMesh(Vertices=deconstruct_mesh_2.Vertices, Faces=deconstruct_mesh_2.Faces, Colours=colour_rgb_3)
create_settings = CreateSettings(
    VoxelSize=Slider(0.3, range=0..2),
    Bandwidth=Slider(0.1, range=0..2),
    Isovalue=Slider(0.8, range=0..2),
    Adaptivity=Slider(1, range=0..1))
mesh_to_volume = MeshToVolume(Mesh=mesh_join, Settings=create_settings)
weaverbird_s_catmull_clark_subdivision = WeaverbirdsCatmullClarkSubdivision(MeshCurves=construct_mesh_2, Level=Slider(2, range=0..3), SmoothNakedEdges=2)
create_settings_2 = CreateSettings(
    VoxelSize=Slider(12, range=0..12),
    Bandwidth=Slider(7.1, range=0..12),
    Isovalue=Slider(0, range=0..2),
    Adaptivity=Slider(0, range=0..1))
smooth_volume = SmoothVolume(Volume=mesh_to_volume, Width=Slider(0.1, range=0.1..10), Type=Slider(0, range=0..3), Iterations=Slider(1, range=0..5))
volume_to_mesh = VolumeToMesh(Volume=smooth_volume, VolumeSettings=create_settings_2)
panel_9 = Panel(volume_to_mesh)
deconstruct_mesh_3 = DeconstructMesh(Mesh=volume_to_mesh)  # -> Vertices, Faces, Colours, Normals
c_script_7 = CSharpScript(x=deconstruct_mesh_3.Vertices, y=c_script.A)  # -> out, A; inputs x: tree of Point3d, y: list of Point3d; same code as c_script_2
flatten_tree_8 = FlattenTree(Tree=c_script_7.A, Path="{0}")
sort_list_5 = SortList(Keys=flatten_tree_8)  # -> Keys, ValuesValuesA
list_item_5 = ListItem(List=sort_list_5.Keys, Index=0, Wrap=True)  # -> Item1, Item
number_slider_7 = Slider(7.9, range=0..20)
panel_10 = Panel(list_item_5.Item1)
construct_domain_7 = ConstructDomain(DomainStart=0, DomainEnd=list_item_5.Item1)
construct_domain_8 = ConstructDomain(DomainStart=0, DomainEnd="255")
remap_numbers_4 = RemapNumbers(Value=c_script_7.A, Source=construct_domain_7, Target=construct_domain_8)  # -> Mapped, Clipped
gradient_4 = Gradient(
    LowerLimit="0",
    UpperLimit="255",
    Parameter=remap_numbers_4.Mapped,
    stops=[0.15: RGB(222, 255, 130), 0.85: RGB(0, 161, 219)])
split_argb_4 = SplitARGB(Colour=gradient_4, IntegerChannels=True)  # -> Alpha, Red, Green, Blue
c_script_8 = CSharpScript(num=remap_numbers_4.Mapped, threshold=Slider(113.276, range=0..255), factor=Slider(5, range=0.1..5))  # -> out, A; inputs num: tree of Double, threshold: Double, factor: Double; same code as c_script_3
colour_rgb_4 = ColourRGB(Alpha=c_script_8.A, Red=split_argb_4.Red, Green=split_argb_4.Green, Blue=split_argb_4.Blue)
construct_mesh_3 = ConstructMesh(Vertices=deconstruct_mesh_3.Vertices, Faces=deconstruct_mesh_3.Faces, Colours=colour_rgb_4)  # -> flatten(Mesh)
