# Grasshopper definition Registry Testing.gh (Grasshopper 1.0.7)

machine_root = Panel("HKEY_LOCAL_MACHINE")
c_script = CSharpScript(x=machine_root)  # -> out, A, B, C, D, E, F; inputs x: String
# ---------- c_script: C# usings ----------
using Microsoft.Win32;
using System.Linq;
# ---------- c_script: C# ----------
    // Local machine sub key count
    // Local machine software subkey count
    Print("Local machine subkey count: " + Registry.LocalMachine.SubKeyCount);
    Print("Local machine/Software subkey count: " + Registry.LocalMachine.OpenSubKey("SOFTWARE").SubKeyCount);
    Print(Environment.NewLine);
    
    Print("Current User subkey count: " + Registry.CurrentUser.SubKeyCount);
    Print("Current User/Software subkey count: " + Registry.CurrentUser.OpenSubKey("SOFTWARE").SubKeyCount);
    Print(Environment.NewLine);

    // does the SNIPE-IT subk key exist
    Print("Does SNIPE-IT sub key exist in LocalMachine: " + Registry.LocalMachine.OpenSubKey("SOFTWARE").GetSubKeyNames().ToList().Exists(name => name == "SNIPE-IT"));
    Print("Does SNIPE-IT sub key exist in CurrentUser: " + Registry.CurrentUser.OpenSubKey("SOFTWARE").GetSubKeyNames().ToList().Exists(name => name == "SNIPE-IT"));
    Print(Environment.NewLine);

    // local machine softwre subkey names
    Print("Local machine/Software subkey names: ");
    foreach(string s in Registry.LocalMachine.OpenSubKey("SOFTWARE").GetSubKeyNames()) Print("    " + s);
    Print(Environment.NewLine);
    
    Print("Curren User/Software subkey names: ");
    foreach(string s in Registry.CurrentUser.OpenSubKey("SOFTWARE").GetSubKeyNames()) Print("    " + s);
    
    
    A = Registry.LocalMachine.OpenSubKey("SOFTWARE").GetSubKeyNames().ToList().Exists(name => name == "SNIPE-IT");

    bool snipeITExists = Registry.LocalMachine.OpenSubKey("SOFTWARE").GetSubKeyNames().ToList().Exists(name => name == "SNIPE-IT");
    if(!snipeITExists)
    {
      // create snipe it folder
      // create snipe it local access token
      // create snipe it server access token
    }
# ---------- end c_script ----------
panel = Panel(c_script.out)
panel_2 = Panel(c_script.A)
